% Simulink data dictionary crs_controllerdic.sldd

KeyON = uint8(2)
Ki = 0.1999809
Kp = 20
ShiftDrive = uint8(2)
Ts = 0.01
brake_threshold = 5
target_dec_hold = 0.05
target_dec_short = 1
target_inc_hold = 0.05
target_inc_short = 1
throt_max = 100
throt_min = 0
tsp_max = 100
tsp_min = 40
FrontDistanceThreshold_mm = Simulink.Parameter(single(5000), Unit="mm")  % Forward vehicle distance threshold for automatic Enable transition.