test file "CruiseControlMode_MCDC_Tests"
  coverage: Decision, MCDC, Condition

suite "CruiseControlMode_MCDC_Suite"

  case "TC01_DisableFlagAllFalse" [baseline]
    description: All disable conditions false: key=KeyON gear=ShiftDrive brakeP=0
    model crs_controller, harness CCMode_MCDC_Probe (for crs_controller/CruiseControlMode)
    input "TC01_DisableFlagAllFalse.mat", mapped to reqDrv, brakeP, vehSp, key, gear, frontDistance (active)
    baseline "TC01_DisableFlagAllFalse_expected.mat"
      status:1
      mode:1
    iterations:
      Iteration1: ExternalInput "TC01_DisableFlagAllFalse.mat"

  case "TC02_IsKeyPositionOn" [baseline]
    description: key=KeyOFF(1) alone determines disable_flag=true->forced Disable
    model crs_controller, harness CCMode_MCDC_Probe (for crs_controller/CruiseControlMode)
    input "TC02_IsKeyPositionOn.mat", mapped to reqDrv, brakeP, vehSp, key, gear, frontDistance (active)
    baseline "TC02_IsKeyPositionOn_expected.mat"
      status:1
      mode:1
    iterations:
      Iteration1: ExternalInput "TC02_IsKeyPositionOn.mat"

  case "TC03_IsShiftDrive" [baseline]
    description: gear=ShiftPark(1) alone determines disable_flag=true->forced Disable
    model crs_controller, harness CCMode_MCDC_Probe (for crs_controller/CruiseControlMode)
    input "TC03_IsShiftDrive.mat", mapped to reqDrv, brakeP, vehSp, key, gear, frontDistance (active)
    baseline "TC03_IsShiftDrive_expected.mat"
      status:1
      mode:1
    iterations:
      Iteration1: ExternalInput "TC03_IsShiftDrive.mat"

  case "TC04_isbrake" [baseline]
    description: brakeP=10>5 alone determines disable_flag=true->forced Disable
    model crs_controller, harness CCMode_MCDC_Probe (for crs_controller/CruiseControlMode)
    input "TC04_isbrake.mat", mapped to reqDrv, brakeP, vehSp, key, gear, frontDistance (active)
    baseline "TC04_isbrake_expected.mat"
      status:1
      mode:1
    iterations:
      Iteration1: ExternalInput "TC04_isbrake.mat"

  case "TC05_OutRangeFalse" [baseline]
    description: vehSp=70 in [40,100]: outRange=false, Set activates
    model crs_controller, harness CCMode_MCDC_Probe (for crs_controller/CruiseControlMode)
    input "TC05_OutRangeFalse.mat", mapped to reqDrv, brakeP, vehSp, key, gear, frontDistance (active)
    baseline "TC05_OutRangeFalse_expected.mat"
      status:1
      mode:1
    iterations:
      Iteration1: ExternalInput "TC05_OutRangeFalse.mat"

  case "TC06_OutRangeTooSlow" [baseline]
    description: vehSp=30<tsp_min=40: outRange=true, activate blocked
    model crs_controller, harness CCMode_MCDC_Probe (for crs_controller/CruiseControlMode)
    input "TC06_OutRangeTooSlow.mat", mapped to reqDrv, brakeP, vehSp, key, gear, frontDistance (active)
    baseline "TC06_OutRangeTooSlow_expected.mat"
      status:1
      mode:1
    iterations:
      Iteration1: ExternalInput "TC06_OutRangeTooSlow.mat"

  case "TC07_OutRangeTooFast" [baseline]
    description: vehSp=110>tsp_max=100: outRange=true, activate blocked
    model crs_controller, harness CCMode_MCDC_Probe (for crs_controller/CruiseControlMode)
    input "TC07_OutRangeTooFast.mat", mapped to reqDrv, brakeP, vehSp, key, gear, frontDistance (active)
    baseline "TC07_OutRangeTooFast_expected.mat"
      status:1
      mode:1
    iterations:
      Iteration1: ExternalInput "TC07_OutRangeTooFast.mat"

  case "TC08_StatusDisable" [baseline]
    description: reqDrv=NoRequest: mode=Disable, RelOp1(!=Disable)=false->status=false
    model crs_controller, harness CCMode_MCDC_Probe (for crs_controller/CruiseControlMode)
    input "TC08_StatusDisable.mat", mapped to reqDrv, brakeP, vehSp, key, gear, frontDistance (active)
    baseline "TC08_StatusDisable_expected.mat"
      status:1
      mode:1
    iterations:
      Iteration1: ExternalInput "TC08_StatusDisable.mat"

  case "TC09_StatusEnable" [baseline]
    description: Cruise then NoReq: mode=Enable, both AND conditions true->status=true
    model crs_controller, harness CCMode_MCDC_Probe (for crs_controller/CruiseControlMode)
    input "TC09_StatusEnable.mat", mapped to reqDrv, brakeP, vehSp, key, gear, frontDistance (active)
    baseline "TC09_StatusEnable_expected.mat"
      status:1
      mode:1
    iterations:
      Iteration1: ExternalInput "TC09_StatusEnable.mat"

  case "TC10_StatusActivate" [baseline]
    description: Set: mode=Activate, RelOp2(==Enable)=false->status=false
    model crs_controller, harness CCMode_MCDC_Probe (for crs_controller/CruiseControlMode)
    input "TC10_StatusActivate.mat", mapped to reqDrv, brakeP, vehSp, key, gear, frontDistance (active)
    baseline "TC10_StatusActivate_expected.mat"
      status:1
      mode:1
    iterations:
      Iteration1: ExternalInput "TC10_StatusActivate.mat"

  case "TC11_ActivateBothTrue" [baseline]
    description: reqDrv=Set AND vehSp=70(inRange): activateCondition->Activate
    model crs_controller, harness CCMode_MCDC_Probe (for crs_controller/CruiseControlMode)
    input "TC11_ActivateBothTrue.mat", mapped to reqDrv, brakeP, vehSp, key, gear, frontDistance (active)
    baseline "TC11_ActivateBothTrue_expected.mat"
      status:1
      mode:1
    iterations:
      Iteration1: ExternalInput "TC11_ActivateBothTrue.mat"

  case "TC12_ActivateReqFalse" [baseline]
    description: reqDrv=NoRequest: activate A=false->stays Disable
    model crs_controller, harness CCMode_MCDC_Probe (for crs_controller/CruiseControlMode)
    input "TC12_ActivateReqFalse.mat", mapped to reqDrv, brakeP, vehSp, key, gear, frontDistance (active)
    baseline "TC12_ActivateReqFalse_expected.mat"
      status:1
      mode:1
    iterations:
      Iteration1: ExternalInput "TC12_ActivateReqFalse.mat"

  case "TC13_ActivateOutRangeFalse" [baseline]
    description: reqDrv=Set AND vehSp=30(outRange): activate B=false->blocked
    model crs_controller, harness CCMode_MCDC_Probe (for crs_controller/CruiseControlMode)
    input "TC13_ActivateOutRangeFalse.mat", mapped to reqDrv, brakeP, vehSp, key, gear, frontDistance (active)
    baseline "TC13_ActivateOutRangeFalse_expected.mat"
      status:1
      mode:1
    iterations:
      Iteration1: ExternalInput "TC13_ActivateOutRangeFalse.mat"

  case "TC14_PressSetSw_True" [baseline]
    description: reqDrv=Cruise(2): pressSetSw=true->Enable
    model crs_controller, harness CCMode_MCDC_Probe (for crs_controller/CruiseControlMode)
    input "TC14_PressSetSw_True.mat", mapped to reqDrv, brakeP, vehSp, key, gear, frontDistance (active)
    baseline "TC14_PressSetSw_True_expected.mat"
      status:1
      mode:1
    iterations:
      Iteration1: ExternalInput "TC14_PressSetSw_True.mat"

  case "TC15_PressSetSw_False" [baseline]
    description: reqDrv=NoRequest: pressSetSw=false->stays Disable
    model crs_controller, harness CCMode_MCDC_Probe (for crs_controller/CruiseControlMode)
    input "TC15_PressSetSw_False.mat", mapped to reqDrv, brakeP, vehSp, key, gear, frontDistance (active)
    baseline "TC15_PressSetSw_False_expected.mat"
      status:1
      mode:1
    iterations:
      Iteration1: ExternalInput "TC15_PressSetSw_False.mat"

  case "TC16_CancelFromActivate" [baseline]
    description: Set->Activate then Cancel: cancelActivation from Activate->Enable
    model crs_controller, harness CCMode_MCDC_Probe (for crs_controller/CruiseControlMode)
    input "TC16_CancelFromActivate.mat", mapped to reqDrv, brakeP, vehSp, key, gear, frontDistance (active)
    baseline "TC16_CancelFromActivate_expected.mat"
      status:1
      mode:1
    iterations:
      Iteration1: ExternalInput "TC16_CancelFromActivate.mat"

  case "TC17_CancelFromIncrement" [baseline]
    description: Set->Activate, Inc_Short->Increment, Cancel->Enable
    model crs_controller, harness CCMode_MCDC_Probe (for crs_controller/CruiseControlMode)
    input "TC17_CancelFromIncrement.mat", mapped to reqDrv, brakeP, vehSp, key, gear, frontDistance (active)
    baseline "TC17_CancelFromIncrement_expected.mat"
      status:1
      mode:1
    iterations:
      Iteration1: ExternalInput "TC17_CancelFromIncrement.mat"

  case "TC18_CancelFromIncrHold" [baseline]
    description: Set->Activate, Inc_Long->IncrHold, Cancel->Enable
    model crs_controller, harness CCMode_MCDC_Probe (for crs_controller/CruiseControlMode)
    input "TC18_CancelFromIncrHold.mat", mapped to reqDrv, brakeP, vehSp, key, gear, frontDistance (active)
    baseline "TC18_CancelFromIncrHold_expected.mat"
      status:1
      mode:1
    iterations:
      Iteration1: ExternalInput "TC18_CancelFromIncrHold.mat"

  case "TC19_CancelFromDecrement" [baseline]
    description: Set->Activate, Dec_Short->Decrement, Cancel->Enable
    model crs_controller, harness CCMode_MCDC_Probe (for crs_controller/CruiseControlMode)
    input "TC19_CancelFromDecrement.mat", mapped to reqDrv, brakeP, vehSp, key, gear, frontDistance (active)
    baseline "TC19_CancelFromDecrement_expected.mat"
      status:1
      mode:1
    iterations:
      Iteration1: ExternalInput "TC19_CancelFromDecrement.mat"

  case "TC20_CancelFromDecrHold" [baseline]
    description: Set->Activate, Dec_Long->DecrHold, Cancel->Enable
    model crs_controller, harness CCMode_MCDC_Probe (for crs_controller/CruiseControlMode)
    input "TC20_CancelFromDecrHold.mat", mapped to reqDrv, brakeP, vehSp, key, gear, frontDistance (active)
    baseline "TC20_CancelFromDecrHold_expected.mat"
      status:1
      mode:1
    iterations:
      Iteration1: ExternalInput "TC20_CancelFromDecrHold.mat"

  case "TC21_CancelFromEnable_False" [baseline]
    description: Cruise->Enable then Cancel: Enable NOT in active modes->stays Enable
    model crs_controller, harness CCMode_MCDC_Probe (for crs_controller/CruiseControlMode)
    input "TC21_CancelFromEnable_False.mat", mapped to reqDrv, brakeP, vehSp, key, gear, frontDistance (active)
    baseline "TC21_CancelFromEnable_False_expected.mat"
      status:1
      mode:1
    iterations:
      Iteration1: ExternalInput "TC21_CancelFromEnable_False.mat"

  case "TC22_KeepActFromActivate" [baseline]
    description: Set->Activate then NoRequest: keepActivated->Activate
    model crs_controller, harness CCMode_MCDC_Probe (for crs_controller/CruiseControlMode)
    input "TC22_KeepActFromActivate.mat", mapped to reqDrv, brakeP, vehSp, key, gear, frontDistance (active)
    baseline "TC22_KeepActFromActivate_expected.mat"
      status:1
      mode:1
    iterations:
      Iteration1: ExternalInput "TC22_KeepActFromActivate.mat"

  case "TC23_KeepActFromIncrement" [baseline]
    description: Set->Activate, Inc_Short->Increment, NoReq->keepActivated->Activate
    model crs_controller, harness CCMode_MCDC_Probe (for crs_controller/CruiseControlMode)
    input "TC23_KeepActFromIncrement.mat", mapped to reqDrv, brakeP, vehSp, key, gear, frontDistance (active)
    baseline "TC23_KeepActFromIncrement_expected.mat"
      status:1
      mode:1
    iterations:
      Iteration1: ExternalInput "TC23_KeepActFromIncrement.mat"

  case "TC24_KeepActFromIncrHold" [baseline]
    description: Set->Activate, Inc_Long->IncrHold, NoReq->keepActivated->Activate
    model crs_controller, harness CCMode_MCDC_Probe (for crs_controller/CruiseControlMode)
    input "TC24_KeepActFromIncrHold.mat", mapped to reqDrv, brakeP, vehSp, key, gear, frontDistance (active)
    baseline "TC24_KeepActFromIncrHold_expected.mat"
      status:1
      mode:1
    iterations:
      Iteration1: ExternalInput "TC24_KeepActFromIncrHold.mat"

  case "TC25_KeepActFromDecrement" [baseline]
    description: Set->Activate, Dec_Short->Decrement, NoReq->keepActivated->Activate
    model crs_controller, harness CCMode_MCDC_Probe (for crs_controller/CruiseControlMode)
    input "TC25_KeepActFromDecrement.mat", mapped to reqDrv, brakeP, vehSp, key, gear, frontDistance (active)
    baseline "TC25_KeepActFromDecrement_expected.mat"
      status:1
      mode:1
    iterations:
      Iteration1: ExternalInput "TC25_KeepActFromDecrement.mat"

  case "TC26_KeepActFromDecrHold" [baseline]
    description: Set->Activate, Dec_Long->DecrHold, NoReq->keepActivated->Activate
    model crs_controller, harness CCMode_MCDC_Probe (for crs_controller/CruiseControlMode)
    input "TC26_KeepActFromDecrHold.mat", mapped to reqDrv, brakeP, vehSp, key, gear, frontDistance (active)
    baseline "TC26_KeepActFromDecrHold_expected.mat"
      status:1
      mode:1
    iterations:
      Iteration1: ExternalInput "TC26_KeepActFromDecrHold.mat"

  case "TC27_KeepActFalse_Enable" [baseline]
    description: Cruise->Enable then NoReq: Enable NOT in active set->stays Enable
    model crs_controller, harness CCMode_MCDC_Probe (for crs_controller/CruiseControlMode)
    input "TC27_KeepActFalse_Enable.mat", mapped to reqDrv, brakeP, vehSp, key, gear, frontDistance (active)
    baseline "TC27_KeepActFalse_Enable_expected.mat"
      status:1
      mode:1
    iterations:
      Iteration1: ExternalInput "TC27_KeepActFalse_Enable.mat"

  case "TC28_KeepActFalse_ReqNotNoReq" [baseline]
    description: Set->Activate then Set: reqDrv!=NoRequest so keepActivated B=false
    model crs_controller, harness CCMode_MCDC_Probe (for crs_controller/CruiseControlMode)
    input "TC28_KeepActFalse_ReqNotNoReq.mat", mapped to reqDrv, brakeP, vehSp, key, gear, frontDistance (active)
    baseline "TC28_KeepActFalse_ReqNotNoReq_expected.mat"
      status:1
      mode:1
    iterations:
      Iteration1: ExternalInput "TC28_KeepActFalse_ReqNotNoReq.mat"

  case "TC29_TurnOffFromActivate" [baseline]
    description: Set->Activate then Cruise: turnOffCruise(Cruise+mode!=Disable)->Disable
    model crs_controller, harness CCMode_MCDC_Probe (for crs_controller/CruiseControlMode)
    input "TC29_TurnOffFromActivate.mat", mapped to reqDrv, brakeP, vehSp, key, gear, frontDistance (active)
    baseline "TC29_TurnOffFromActivate_expected.mat"
      status:1
      mode:1
    iterations:
      Iteration1: ExternalInput "TC29_TurnOffFromActivate.mat"

  case "TC30_TurnOffFromEnable" [baseline]
    description: Cruise->Enable, NoReq stays Enable, then Cruise: turnOff->Disable
    model crs_controller, harness CCMode_MCDC_Probe (for crs_controller/CruiseControlMode)
    input "TC30_TurnOffFromEnable.mat", mapped to reqDrv, brakeP, vehSp, key, gear, frontDistance (active)
    baseline "TC30_TurnOffFromEnable_expected.mat"
      status:1
      mode:1
    iterations:
      Iteration1: ExternalInput "TC30_TurnOffFromEnable.mat"

  case "TC31_CruiseFromDisable_NoTurnOff" [baseline]
    description: Cruise from Disable: turnOff A=false(mode==Disable)->Enable
    model crs_controller, harness CCMode_MCDC_Probe (for crs_controller/CruiseControlMode)
    input "TC31_CruiseFromDisable_NoTurnOff.mat", mapped to reqDrv, brakeP, vehSp, key, gear, frontDistance (active)
    baseline "TC31_CruiseFromDisable_NoTurnOff_expected.mat"
      status:1
      mode:1
    iterations:
      Iteration1: ExternalInput "TC31_CruiseFromDisable_NoTurnOff.mat"

  case "TC32_WaitingIncMiddle" [baseline]
    description: Cruise->Enable, Inc_Middle: waitingForButtonHolding A=true->Activate
    model crs_controller, harness CCMode_MCDC_Probe (for crs_controller/CruiseControlMode)
    input "TC32_WaitingIncMiddle.mat", mapped to reqDrv, brakeP, vehSp, key, gear, frontDistance (active)
    baseline "TC32_WaitingIncMiddle_expected.mat"
      status:1
      mode:1
    iterations:
      Iteration1: ExternalInput "TC32_WaitingIncMiddle.mat"

  case "TC33_WaitingDecMiddle" [baseline]
    description: Cruise->Enable, Dec_Middle: waitingForButtonHolding B=true->Activate
    model crs_controller, harness CCMode_MCDC_Probe (for crs_controller/CruiseControlMode)
    input "TC33_WaitingDecMiddle.mat", mapped to reqDrv, brakeP, vehSp, key, gear, frontDistance (active)
    baseline "TC33_WaitingDecMiddle_expected.mat"
      status:1
      mode:1
    iterations:
      Iteration1: ExternalInput "TC33_WaitingDecMiddle.mat"

  case "TC34_WaitingFalse_IncShort" [baseline]
    description: Cruise->Enable, Inc_Short: neither Middle->keepActivated B=false->Enable stays
    model crs_controller, harness CCMode_MCDC_Probe (for crs_controller/CruiseControlMode)
    input "TC34_WaitingFalse_IncShort.mat", mapped to reqDrv, brakeP, vehSp, key, gear, frontDistance (active)
    baseline "TC34_WaitingFalse_IncShort_expected.mat"
      status:1
      mode:1
    iterations:
      Iteration1: ExternalInput "TC34_WaitingFalse_IncShort.mat"

  case "TC35_ResumeToActive" [baseline]
    description: Set->Activate, Cancel->Enable, ResumeReq->Resume, then Resume prev->Activate
    model crs_controller, harness CCMode_MCDC_Probe (for crs_controller/CruiseControlMode)
    input "TC35_ResumeToActive.mat", mapped to reqDrv, brakeP, vehSp, key, gear, frontDistance (active)
    baseline "TC35_ResumeToActive_expected.mat"
      status:1
      mode:1
    iterations:
      Iteration1: ExternalInput "TC35_ResumeToActive.mat"

  case "TC36_ResumeToActive_False" [baseline]
    description: Cruise->Enable, ResumeReq: mode_prev!=Resume->resumeToActive=false->Enable
    model crs_controller, harness CCMode_MCDC_Probe (for crs_controller/CruiseControlMode)
    input "TC36_ResumeToActive_False.mat", mapped to reqDrv, brakeP, vehSp, key, gear, frontDistance (active)
    baseline "TC36_ResumeToActive_False_expected.mat"
      status:1
      mode:1
    iterations:
      Iteration1: ExternalInput "TC36_ResumeToActive_False.mat"

  case "TC37_EnableToResume_True" [baseline]
    description: Set->Act, Cancel->Enable, ResumeReq: enableToResume AND hasCanceled->Resume
    model crs_controller, harness CCMode_MCDC_Probe (for crs_controller/CruiseControlMode)
    input "TC37_EnableToResume_True.mat", mapped to reqDrv, brakeP, vehSp, key, gear, frontDistance (active)
    baseline "TC37_EnableToResume_True_expected.mat"
      status:1
      mode:1
    iterations:
      Iteration1: ExternalInput "TC37_EnableToResume_True.mat"

  case "TC38_EnableToResume_ReqFalse" [baseline]
    description: Cruise->Enable, NoReq: reqDrv!=ResumeReq->enableToResume A=false->Enable
    model crs_controller, harness CCMode_MCDC_Probe (for crs_controller/CruiseControlMode)
    input "TC38_EnableToResume_ReqFalse.mat", mapped to reqDrv, brakeP, vehSp, key, gear, frontDistance (active)
    baseline "TC38_EnableToResume_ReqFalse_expected.mat"
      status:1
      mode:1
    iterations:
      Iteration1: ExternalInput "TC38_EnableToResume_ReqFalse.mat"

  case "TC39_EnableToResume_ModeFalse" [baseline]
    description: Set->Activate, ResumeReq: mode_prev=Activate!=Enable->B=false->Activate
    model crs_controller, harness CCMode_MCDC_Probe (for crs_controller/CruiseControlMode)
    input "TC39_EnableToResume_ModeFalse.mat", mapped to reqDrv, brakeP, vehSp, key, gear, frontDistance (active)
    baseline "TC39_EnableToResume_ModeFalse_expected.mat"
      status:1
      mode:1
    iterations:
      Iteration1: ExternalInput "TC39_EnableToResume_ModeFalse.mat"

  case "TC40_HasCanceled_True" [baseline]
    description: Set->Act, Cancel->Enable, ResumeReq: hasCanceled=true(via Delay)->Resume
    model crs_controller, harness CCMode_MCDC_Probe (for crs_controller/CruiseControlMode)
    input "TC40_HasCanceled_True.mat", mapped to reqDrv, brakeP, vehSp, key, gear, frontDistance (active)
    baseline "TC40_HasCanceled_True_expected.mat"
      status:1
      mode:1
    iterations:
      Iteration1: ExternalInput "TC40_HasCanceled_True.mat"

  case "TC41_HasCanceled_False" [baseline]
    description: Cruise->Enable, ResumeReq without prior cancel: hasCanceled=false->Enable
    model crs_controller, harness CCMode_MCDC_Probe (for crs_controller/CruiseControlMode)
    input "TC41_HasCanceled_False.mat", mapped to reqDrv, brakeP, vehSp, key, gear, frontDistance (active)
    baseline "TC41_HasCanceled_False_expected.mat"
      status:1
      mode:1
    iterations:
      Iteration1: ExternalInput "TC41_HasCanceled_False.mat"

  case "TC42_IncrShort" [baseline]
    description: Set->Activate then Inc_Short: IncrementDecrement->Increment(4)
    model crs_controller, harness CCMode_MCDC_Probe (for crs_controller/CruiseControlMode)
    input "TC42_IncrShort.mat", mapped to reqDrv, brakeP, vehSp, key, gear, frontDistance (active)
    baseline "TC42_IncrShort_expected.mat"
      status:1
      mode:1
    iterations:
      Iteration1: ExternalInput "TC42_IncrShort.mat"

  case "TC43_IncrLong" [baseline]
    description: Set->Activate then Inc_Long: IncrementDecrement->IncrementHold(5)
    model crs_controller, harness CCMode_MCDC_Probe (for crs_controller/CruiseControlMode)
    input "TC43_IncrLong.mat", mapped to reqDrv, brakeP, vehSp, key, gear, frontDistance (active)
    baseline "TC43_IncrLong_expected.mat"
      status:1
      mode:1
    iterations:
      Iteration1: ExternalInput "TC43_IncrLong.mat"

  case "TC44_DecrShort" [baseline]
    description: Set->Activate then Dec_Short: IncrementDecrement->Decrement(6)
    model crs_controller, harness CCMode_MCDC_Probe (for crs_controller/CruiseControlMode)
    input "TC44_DecrShort.mat", mapped to reqDrv, brakeP, vehSp, key, gear, frontDistance (active)
    baseline "TC44_DecrShort_expected.mat"
      status:1
      mode:1
    iterations:
      Iteration1: ExternalInput "TC44_DecrShort.mat"

  case "TC45_DecrLong" [baseline]
    description: Set->Activate then Dec_Long: IncrementDecrement->DecrementHold(7)
    model crs_controller, harness CCMode_MCDC_Probe (for crs_controller/CruiseControlMode)
    input "TC45_DecrLong.mat", mapped to reqDrv, brakeP, vehSp, key, gear, frontDistance (active)
    baseline "TC45_DecrLong_expected.mat"
      status:1
      mode:1
    iterations:
      Iteration1: ExternalInput "TC45_DecrLong.mat"

  case "TC46_TopSwitch_DisableFlagTrue" [baseline]
    description: key=KeyOFF: disable_flag=true, SID19 Switch->Disable regardless of opMode
    model crs_controller, harness CCMode_MCDC_Probe (for crs_controller/CruiseControlMode)
    input "TC46_TopSwitch_DisableFlagTrue.mat", mapped to reqDrv, brakeP, vehSp, key, gear, frontDistance (active)
    baseline "TC46_TopSwitch_DisableFlagTrue_expected.mat"
      status:1
      mode:1
    iterations:
      Iteration1: ExternalInput "TC46_TopSwitch_DisableFlagTrue.mat"

  case "TC48_FrontDistanceAutoEnable" [baseline]
    description: frontDistance <= 5000 mm while mode_prev is Activate returns mode to Enable.
    model crs_controller, harness CCMode_MCDC_Probe (for crs_controller/CruiseControlMode)
    input "TC48_FrontDistanceAutoEnable.mat" (active)
    baseline "TC48_FrontDistanceAutoEnable_expected.mat"
      status:1
      mode:1

  case "TC49_FrontDistanceAboveThreshold" [baseline]
    description: frontDistance > 5000 mm does not trigger automatic Enable from Activate.
    model crs_controller, harness CCMode_MCDC_Probe (for crs_controller/CruiseControlMode)
    input "TC49_FrontDistanceAboveThreshold.mat" (active)
    baseline "TC49_FrontDistanceAboveThreshold_expected.mat"
      status:1
      mode:1