test file "DriverSwRequest_MCDC_Tests"
  coverage: Decision, MCDC, Condition

suite "新規テスト スイート 1"

  case "新規テスト ケース 1" [baseline]

suite "DriverSwRequest_MCDC_Suite"

  case "TC01_NoInput" [baseline]
    description: 全入力0: NoRequest（全Switchのfalseパス）
    model crs_controller, harness DriverSwRequest_MCDC_Harness (for crs_controller/DriverSwRequest)
    input "TC01_NoInput.mat", mapped to enbl, cncl, set, resume, inc, dec (active)
    baseline "TC01_NoInput_expected.mat"
      reqDrv:1

  case "TC02_Cancel" [baseline]
    description: cncl=1: Cancel出力（Switch trueパス）
    model crs_controller, harness DriverSwRequest_MCDC_Harness (for crs_controller/DriverSwRequest)
    input "TC02_Cancel.mat", mapped to enbl, cncl, set, resume, inc, dec (active)
    baseline "TC02_Cancel_expected.mat"
      reqDrv:1

  case "TC03_Cruise" [baseline]
    description: enbl=1: Cruise出力（Switch1 trueパス）
    model crs_controller, harness DriverSwRequest_MCDC_Harness (for crs_controller/DriverSwRequest)
    input "TC03_Cruise.mat", mapped to enbl, cncl, set, resume, inc, dec (active)
    baseline "TC03_Cruise_expected.mat"
      reqDrv:1

  case "TC04_Set" [baseline]
    description: set=1: Set出力（Switch2 trueパス）
    model crs_controller, harness DriverSwRequest_MCDC_Harness (for crs_controller/DriverSwRequest)
    input "TC04_Set.mat", mapped to enbl, cncl, set, resume, inc, dec (active)
    baseline "TC04_Set_expected.mat"
      reqDrv:1

  case "TC05_Resume" [baseline]
    description: resume=1: ResumeReq出力（Switch3 trueパス）
    model crs_controller, harness DriverSwRequest_MCDC_Harness (for crs_controller/DriverSwRequest)
    input "TC05_Resume.mat", mapped to enbl, cncl, set, resume, inc, dec (active)
    baseline "TC05_Resume_expected.mat"
      reqDrv:1

  case "TC06_PriorCncl" [baseline]
    description: cncl+enbl同時: cncl優先でCancel
    model crs_controller, harness DriverSwRequest_MCDC_Harness (for crs_controller/DriverSwRequest)
    input "TC06_PriorCncl.mat", mapped to enbl, cncl, set, resume, inc, dec (active)
    baseline "TC06_PriorCncl_expected.mat"
      reqDrv:1

  case "TC07_PriorEnbl" [baseline]
    description: enbl+set同時: enbl優先でCruise
    model crs_controller, harness DriverSwRequest_MCDC_Harness (for crs_controller/DriverSwRequest)
    input "TC07_PriorEnbl.mat", mapped to enbl, cncl, set, resume, inc, dec (active)
    baseline "TC07_PriorEnbl_expected.mat"
      reqDrv:1

  case "TC08_PriorSet" [baseline]
    description: set+resume同時: set優先でSet
    model crs_controller, harness DriverSwRequest_MCDC_Harness (for crs_controller/DriverSwRequest)
    input "TC08_PriorSet.mat", mapped to enbl, cncl, set, resume, inc, dec (active)
    baseline "TC08_PriorSet_expected.mat"
      reqDrv:1

  case "TC09_PriorResume" [baseline]
    description: resume+inc同時: resume優先でResumeReq
    model crs_controller, harness DriverSwRequest_MCDC_Harness (for crs_controller/DriverSwRequest)
    input "TC09_PriorResume.mat", mapped to enbl, cncl, set, resume, inc, dec (active)
    baseline "TC09_PriorResume_expected.mat"
      reqDrv:1

  case "TC10_CnclRepeat" [baseline]
    description: cncl 2サイクル: Cancel→NoRequest（doNot Repeat AND=true, Cancel条件）
    model crs_controller, harness DriverSwRequest_MCDC_Harness (for crs_controller/DriverSwRequest)
    input "TC10_CnclRepeat.mat", mapped to enbl, cncl, set, resume, inc, dec (active)
    baseline "TC10_CnclRepeat_expected.mat"
      reqDrv:1

  case "TC11_CruiseRepeat" [baseline]
    description: enbl 2サイクル: Cruise→NoRequest（Cruise条件独立）
    model crs_controller, harness DriverSwRequest_MCDC_Harness (for crs_controller/DriverSwRequest)
    input "TC11_CruiseRepeat.mat", mapped to enbl, cncl, set, resume, inc, dec (active)
    baseline "TC11_CruiseRepeat_expected.mat"
      reqDrv:1

  case "TC12_SetRepeat" [baseline]
    description: set 2サイクル: Set→NoRequest（Set条件独立）
    model crs_controller, harness DriverSwRequest_MCDC_Harness (for crs_controller/DriverSwRequest)
    input "TC12_SetRepeat.mat", mapped to enbl, cncl, set, resume, inc, dec (active)
    baseline "TC12_SetRepeat_expected.mat"
      reqDrv:1

  case "TC13_ResumeRepeat" [baseline]
    description: resume 2サイクル: ResumeReq→NoRequest（ResumeReq条件独立）
    model crs_controller, harness DriverSwRequest_MCDC_Harness (for crs_controller/DriverSwRequest)
    input "TC13_ResumeRepeat.mat", mapped to enbl, cncl, set, resume, inc, dec (active)
    baseline "TC13_ResumeRepeat_expected.mat"
      reqDrv:1

  case "TC14_IncNoSuppress" [baseline]
    description: inc 3サイクル継続: Inc反復抑制なし（doNot Repeat LogicOp3=false）
    model crs_controller, harness DriverSwRequest_MCDC_Harness (for crs_controller/DriverSwRequest)
    input "TC14_IncNoSuppress.mat", mapped to enbl, cncl, set, resume, inc, dec (active)
    baseline "TC14_IncNoSuppress_expected.mat"
      reqDrv:1

  case "TC15_DecShort" [baseline]
    description: dec 1サイクル: Dec_Short（Switch1 trueパス, LogicOp3=false）
    model crs_controller, harness DriverSwRequest_MCDC_Harness (for crs_controller/DriverSwRequest)
    input "TC15_DecShort.mat", mapped to enbl, cncl, set, resume, inc, dec (active)
    baseline "TC15_DecShort_expected.mat"
      reqDrv:1

  case "TC16_DecOff" [baseline]
    description: dec=0: NoRequest（Switch1 falseパス）
    model crs_controller, harness DriverSwRequest_MCDC_Harness (for crs_controller/DriverSwRequest)
    input "TC16_DecOff.mat", mapped to enbl, cncl, set, resume, inc, dec (active)
    baseline "TC16_DecOff_expected.mat"
      reqDrv:1

  case "TC17_DecMiddle_fromShort" [baseline]
    description: dec 2サイクル: Dec_Short→Dec_Middle（LogicOp3 relop_short=true）
    model crs_controller, harness DriverSwRequest_MCDC_Harness (for crs_controller/DriverSwRequest)
    input "TC17_DecMiddle_fromShort.mat", mapped to enbl, cncl, set, resume, inc, dec (active)
    baseline "TC17_DecMiddle_fromShort_expected.mat"
      reqDrv:1

  case "TC18_DecMiddle_fromMiddle" [baseline]
    description: dec 3サイクル: Dec_Middle継続（LogicOp3 relop_middle=true 独立）
    model crs_controller, harness DriverSwRequest_MCDC_Harness (for crs_controller/DriverSwRequest)
    input "TC18_DecMiddle_fromMiddle.mat", mapped to enbl, cncl, set, resume, inc, dec (active)
    baseline "TC18_DecMiddle_fromMiddle_expected.mat"
      reqDrv:1

  case "TC19_DecMiddle_LogicFalse" [baseline]
    description: dec押して即リリース: LogicOp1=false（LogicOp3=true,dec_sw=false）
    model crs_controller, harness DriverSwRequest_MCDC_Harness (for crs_controller/DriverSwRequest)
    input "TC19_DecMiddle_LogicFalse.mat", mapped to enbl, cncl, set, resume, inc, dec (active)
    baseline "TC19_DecMiddle_LogicFalse_expected.mat"
      reqDrv:1

  case "TC20_DecLong_Counter" [baseline]
    description: dec 50サイクル継続: Dec_Long（カウンタ到達, Switch4 true）
    model crs_controller, harness DriverSwRequest_MCDC_Harness (for crs_controller/DriverSwRequest)
    input "TC20_DecLong_Counter.mat", mapped to enbl, cncl, set, resume, inc, dec (active)
    baseline "TC20_DecLong_Counter_expected.mat"
      reqDrv:1

  case "TC21_DecLong_Hold" [baseline]
    description: dec 53サイクル: Dec_Long維持（LogicOp_hold_long=true）
    model crs_controller, harness DriverSwRequest_MCDC_Harness (for crs_controller/DriverSwRequest)
    input "TC21_DecLong_Hold.mat", mapped to enbl, cncl, set, resume, inc, dec (active)
    baseline "TC21_DecLong_Hold_expected.mat"
      reqDrv:1

  case "TC22_DecLong_Release" [baseline]
    description: Dec_Long後にdec解放: LogicOp_hold_long=false（dec_sw=false）
    model crs_controller, harness DriverSwRequest_MCDC_Harness (for crs_controller/DriverSwRequest)
    input "TC22_DecLong_Release.mat", mapped to enbl, cncl, set, resume, inc, dec (active)
    baseline "TC22_DecLong_Release_expected.mat"
      reqDrv:1

  case "TC23_DecShort_HoldFalse" [baseline]
    description: dec 1サイクル: prev≠Dec_Long → Switch_hold_long falseパス
    model crs_controller, harness DriverSwRequest_MCDC_Harness (for crs_controller/DriverSwRequest)
    input "TC23_DecShort_HoldFalse.mat", mapped to enbl, cncl, set, resume, inc, dec (active)
    baseline "TC23_DecShort_HoldFalse_expected.mat"
      reqDrv:1

  case "TC24_IncShort" [baseline]
    description: inc 1サイクル: Inc_Short（Switch1 trueパス）
    model crs_controller, harness DriverSwRequest_MCDC_Harness (for crs_controller/DriverSwRequest)
    input "TC24_IncShort.mat", mapped to enbl, cncl, set, resume, inc, dec (active)
    baseline "TC24_IncShort_expected.mat"
      reqDrv:1

  case "TC25_IncOff" [baseline]
    description: inc=0: increment Switch1 falseパス
    model crs_controller, harness DriverSwRequest_MCDC_Harness (for crs_controller/DriverSwRequest)
    input "TC25_IncOff.mat", mapped to enbl, cncl, set, resume, inc, dec (active)
    baseline "TC25_IncOff_expected.mat"
      reqDrv:1

  case "TC26_IncMiddle_fromShort" [baseline]
    description: inc 2サイクル: Inc_Short→Inc_Middle（prev==Inc_Short）
    model crs_controller, harness DriverSwRequest_MCDC_Harness (for crs_controller/DriverSwRequest)
    input "TC26_IncMiddle_fromShort.mat", mapped to enbl, cncl, set, resume, inc, dec (active)
    baseline "TC26_IncMiddle_fromShort_expected.mat"
      reqDrv:1

  case "TC27_IncMiddle_fromMiddle" [baseline]
    description: inc 3サイクル: Inc_Middle継続（prev==Inc_Middle）
    model crs_controller, harness DriverSwRequest_MCDC_Harness (for crs_controller/DriverSwRequest)
    input "TC27_IncMiddle_fromMiddle.mat", mapped to enbl, cncl, set, resume, inc, dec (active)
    baseline "TC27_IncMiddle_fromMiddle_expected.mat"
      reqDrv:1

  case "TC28_IncLogic1_False" [baseline]
    description: inc押してリリース: LogicOp1=false（LogicOp3=true,inc_sw=false）
    model crs_controller, harness DriverSwRequest_MCDC_Harness (for crs_controller/DriverSwRequest)
    input "TC28_IncLogic1_False.mat", mapped to enbl, cncl, set, resume, inc, dec (active)
    baseline "TC28_IncLogic1_False_expected.mat"
      reqDrv:1

  case "TC29_IncLong_Counter" [baseline]
    description: inc 50サイクル: Inc_Long（カウンタ到達）
    model crs_controller, harness DriverSwRequest_MCDC_Harness (for crs_controller/DriverSwRequest)
    input "TC29_IncLong_Counter.mat", mapped to enbl, cncl, set, resume, inc, dec (active)
    baseline "TC29_IncLong_Counter_expected.mat"
      reqDrv:1

  case "TC30_IncLong_Hold" [baseline]
    description: inc長押し: Inc_Long維持（LogicOp_hold_long=true）
    model crs_controller, harness DriverSwRequest_MCDC_Harness (for crs_controller/DriverSwRequest)
    input "TC30_IncLong_Hold.mat", mapped to enbl, cncl, set, resume, inc, dec (active)
    baseline "TC30_IncLong_Hold_expected.mat"
      reqDrv:1

  case "TC31_IncLong_Release" [baseline]
    description: Inc_Long後にinc解放: LogicOp_hold_long=false
    model crs_controller, harness DriverSwRequest_MCDC_Harness (for crs_controller/DriverSwRequest)
    input "TC31_IncLong_Release.mat", mapped to enbl, cncl, set, resume, inc, dec (active)
    baseline "TC31_IncLong_Release_expected.mat"
      reqDrv:1

  case "TC32_IncShort_HoldFalse" [baseline]
    description: inc 1サイクル: prev≠Inc_Long → Switch_hold_long falseパス
    model crs_controller, harness DriverSwRequest_MCDC_Harness (for crs_controller/DriverSwRequest)
    input "TC32_IncShort_HoldFalse.mat", mapped to enbl, cncl, set, resume, inc, dec (active)
    baseline "TC32_IncShort_HoldFalse_expected.mat"
      reqDrv:1