test file "TST_MCDC_Tests"
  coverage: Decision, MCDC, Condition

suite "新規テスト スイート 1"

  case "新規テスト ケース 1" [baseline]

suite "TST_MCDC_Suite"

  case "TC01_Disable" [baseline]
    description: mode=Disable: relop1=T, NOR=F（Disable）, disabled subsystem, Merge, UnitDelay
    model crs_controller, harness TST_MCDC_Harness (for crs_controller/TargetSpeedThrottle)
    input "TC01_Disable.mat", mapped to mode, vehSp, throtDrv (active)
    baseline "TC01_Disable_expected.mat"
      Output Conversion Subsystem:1
      Output Conversion Subsystem:2

  case "TC02_Enable" [baseline]
    description: mode=Enable: relop2=T, NOR=F（Enable）, enabled subsystem
    model crs_controller, harness TST_MCDC_Harness (for crs_controller/TargetSpeedThrottle)
    input "TC02_Enable.mat", mapped to mode, vehSp, throtDrv (active)
    baseline "TC02_Enable_expected.mat"
      Output Conversion Subsystem:1
      Output Conversion Subsystem:2

  case "TC03_Activate" [baseline]
    description: mode=Activate: NOR=T, RelOp2=T, Switch=T（targetSpIn保持）, UsePI=F(relop=F)
    model crs_controller, harness TST_MCDC_Harness (for crs_controller/TargetSpeedThrottle)
    input "TC03_Activate.mat", mapped to mode, vehSp, throtDrv (active)
    baseline "TC03_Activate_expected.mat"
      Output Conversion Subsystem:1
      Output Conversion Subsystem:2

  case "TC04_Resume" [baseline]
    description: Activate→Enable→Resume: relop3=T, NOR=F（Resume）, LogicOp1=T（storeSpeed格納）, Switch5=T（resume=T）
    model crs_controller, harness TST_MCDC_Harness (for crs_controller/TargetSpeedThrottle)
    input "TC04_Resume.mat", mapped to mode, vehSp, throtDrv (active)
    baseline "TC04_Resume_expected.mat"
      Output Conversion Subsystem:1
      Output Conversion Subsystem:2

  case "TC05_LogicOp1_prevActFalse" [baseline]
    description: Enable×3: LogicOp1=F（isEnabled=T, prev_isActivated=F → AND=F, prev_isActivated独立）
    model crs_controller, harness TST_MCDC_Harness (for crs_controller/TargetSpeedThrottle)
    input "TC05_LogicOp1_prevActFalse.mat", mapped to mode, vehSp, throtDrv (active)
    baseline "TC05_LogicOp1_prevActFalse_expected.mat"
      Output Conversion Subsystem:1
      Output Conversion Subsystem:2

  case "TC06_LogicOp1_enFalse" [baseline]
    description: Activate→Disable: LogicOp1=F（isEnabled=F, prev_isActivated=T → AND=F, isEnabled独立）
    model crs_controller, harness TST_MCDC_Harness (for crs_controller/TargetSpeedThrottle)
    input "TC06_LogicOp1_enFalse.mat", mapped to mode, vehSp, throtDrv (active)
    baseline "TC06_LogicOp1_enFalse_expected.mat"
      Output Conversion Subsystem:1
      Output Conversion Subsystem:2

  case "TC07_Increment" [baseline]
    description: mode=Increment: RelOp1=T, Switch=F, Switch1=T, Add1(+1km/h)実行
    model crs_controller, harness TST_MCDC_Harness (for crs_controller/TargetSpeedThrottle)
    input "TC07_Increment.mat", mapped to mode, vehSp, throtDrv (active)
    baseline "TC07_Increment_expected.mat"
      Output Conversion Subsystem:1
      Output Conversion Subsystem:2

  case "TC08_IncrementHold" [baseline]
    description: mode=IncrementHold: RelOp3=T, Switch1=F, Switch2=T, Add2(+0.05km/h)実行
    model crs_controller, harness TST_MCDC_Harness (for crs_controller/TargetSpeedThrottle)
    input "TC08_IncrementHold.mat", mapped to mode, vehSp, throtDrv (active)
    baseline "TC08_IncrementHold_expected.mat"
      Output Conversion Subsystem:1
      Output Conversion Subsystem:2

  case "TC09_Decrement" [baseline]
    description: mode=Decrement: RelOp4=T, Switch2=F, Switch3=T, Add3(-1km/h)実行
    model crs_controller, harness TST_MCDC_Harness (for crs_controller/TargetSpeedThrottle)
    input "TC09_Decrement.mat", mapped to mode, vehSp, throtDrv (active)
    baseline "TC09_Decrement_expected.mat"
      Output Conversion Subsystem:1
      Output Conversion Subsystem:2

  case "TC10_DecrementHold" [baseline]
    description: mode=DecrementHold: RelOp4=F, Switch3=F, Add4(-0.05km/h)実行
    model crs_controller, harness TST_MCDC_Harness (for crs_controller/TargetSpeedThrottle)
    input "TC10_DecrementHold.mat", mapped to mode, vehSp, throtDrv (active)
    baseline "TC10_DecrementHold_expected.mat"
      Output Conversion Subsystem:1
      Output Conversion Subsystem:2

  case "TC11_SatLow" [baseline]
    description: Decrement from tsp_min(40): 39 → クランプ 40 km/h（Saturation 下限パス）
    model crs_controller, harness TST_MCDC_Harness (for crs_controller/TargetSpeedThrottle)
    input "TC11_SatLow.mat", mapped to mode, vehSp, throtDrv (active)
    baseline "TC11_SatLow_expected.mat"
      Output Conversion Subsystem:1
      Output Conversion Subsystem:2

  case "TC12_SatHigh" [baseline]
    description: Increment×61: 101 → クランプ 100 km/h（Saturation 上限パス）, N=63
    model crs_controller, harness TST_MCDC_Harness (for crs_controller/TargetSpeedThrottle)
    input "TC12_SatHigh.mat", mapped to mode, vehSp, throtDrv (active)
    baseline "TC12_SatHigh_expected.mat"
      Output Conversion Subsystem:1
      Output Conversion Subsystem:2

  case "TC13_UsePITrue" [baseline]
    description: vehSp=30<targetSp=40, throtDrv=0: UsePI=T(relop=T,RelOp=T), PI有効, Sat2上限クランプ(100%)
    model crs_controller, harness TST_MCDC_Harness (for crs_controller/TargetSpeedThrottle)
    input "TC13_UsePITrue.mat", mapped to mode, vehSp, throtDrv (active)
    baseline "TC13_UsePITrue_expected.mat"
      Output Conversion Subsystem:1
      Output Conversion Subsystem:2

  case "TC14_UsePI_relpFalse" [baseline]
    description: vehSp=50>targetSp=40: relop=F → UsePI=F（relop独立）, Switch=F, throtCC=throtDrv
    model crs_controller, harness TST_MCDC_Harness (for crs_controller/TargetSpeedThrottle)
    input "TC14_UsePI_relpFalse.mat", mapped to mode, vehSp, throtDrv (active)
    baseline "TC14_UsePI_relpFalse_expected.mat"
      Output Conversion Subsystem:1
      Output Conversion Subsystem:2

  case "TC15_UsePI_RelOpFalse" [baseline]
    description: throtDrv=50>throtPI=0: RelOp=F → UsePI=F（RelOp独立）, Switch=F, throtCC=throtDrv=50
    model crs_controller, harness TST_MCDC_Harness (for crs_controller/TargetSpeedThrottle)
    input "TC15_UsePI_RelOpFalse.mat", mapped to mode, vehSp, throtDrv (active)
    baseline "TC15_UsePI_RelOpFalse_expected.mat"
      Output Conversion Subsystem:1
      Output Conversion Subsystem:2

  case "TC16_Sat2Lower" [baseline]
    description: throtDrv=-5: UsePI=F→Switch→Sat2下限クランプ 0%（Saturation2 下限パス）
    model crs_controller, harness TST_MCDC_Harness (for crs_controller/TargetSpeedThrottle)
    input "TC16_Sat2Lower.mat", mapped to mode, vehSp, throtDrv (active)
    baseline "TC16_Sat2Lower_expected.mat"
      Output Conversion Subsystem:1
      Output Conversion Subsystem:2